% Simulink data dictionary RobotDD.sldd

sensordata = Simulink.Bus()
  timestamp: double, Unit="seconds"
  direction1: double, Unit="degrees"
  direction2: double, Unit="degrees"
  distance1: double, Unit="meters"
  distance2: double, Unit="meters"
  position1: double, Unit="degrees"
  position2: double, Unit="degrees"